# Grasshopper definition blocksfab.gh (Grasshopper 1.0.7)
# plug-ins: Pufferfish, NGon, Human

mesh = Mesh(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)
mesh_2 = Mesh(mesh)
face_boundaries = FaceBoundaries(Mesh=mesh_2)
control_polygon = ControlPolygon(Curve=face_boundaries)  # -> Polygon, Points
list_item = ListItem(List=control_polygon.Points, Index=0, Wrap=True)  # -> Item, Item1, Item2
incircle = InCircle(CornerA=list_item.Item, CornerB=list_item.Item1, CornerC=list_item.Item2)  # -> Circle, Plane, Radius
deconstruct_plane = DeconstructPlane(Plane=flatten(incircle.Plane))  # -> Origin, XAxis, YAxis, ZAxis
# Plankton.dll needed
c_script = CSharpScript(
    mesh=mesh_2,
    ct=deconstruct_plane.Origin,
    Reference=["C:\Users\yangw\AppData\Roaming\Grasshopper\Libraries\Plankton.dll", "C:\Users\yangw\AppData\Roaming\Grasshopper\Libraries\PlanktonGh.dll"])  # -> out, verticeAdjFacesId, verticeIdAtAdjFaces, planktonMesh, averagePlane, faceVIndices, adjFaceIndices, vertices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; inputs mesh: Mesh, ct: list of Point3d
# ---------- c_script: C# usings ----------
using Plankton;
using PlanktonGh;
# ---------- c_script: C# ----------
    var dual = mesh.ToPlanktonMesh().Dual();
    dual.ReplaceVertices(ct);

    DataTree<int> vf_adj = new DataTree<int>();
    DataTree<int> vf_adj_id = new DataTree<int>();

    var vs = dual.Vertices;
    var hes = dual.Halfedges;

    List<Plane> pls = new List<Plane>();
    List<Interval> domains = new List<Interval>();
    DataTree<int> adjf_indices = new DataTree<int>();
    DataTree<int> pts_indices = new DataTree<int>();


    Point3d[] vts = new Point3d[dual.Vertices.Count];
    for(int i = 0;i < dual.Vertices.Count;i++)
    {
      vts[i] = vs[i].ToPoint3d();
      List<int> f_id = new List<int>();
      List<int> v_at_f_id = new List<int>();
      foreach(int he in hes.GetVertexCirculator(vs[i].OutgoingHalfedge))
      {
        int face = dual.Halfedges[he].AdjacentFace;
        if(face >= 0)
        {
          f_id.Add(face);
          int id = 0;
          foreach(int she in dual.Faces.GetHalfedgesCirculator(face))
          {
            if(hes[she].StartVertex == i)break;
            id++;
          }
          v_at_f_id.Add(id);
        }
      }
      vf_adj_id.AddRange(v_at_f_id, new GH_Path(i));
      vf_adj.AddRange(f_id, new GH_Path(i));
    }
    verticeAdjFacesId = vf_adj_id;
    verticeIdAtAdjFaces = vf_adj;

    for(int i = 0;i < dual.Faces.Count;i++)
    {
      Plane pl;
      Point3d pA = new Point3d();
      Interval dom = new Interval(double.MaxValue, double.MinValue);
      List<Point3d> pts = new List<Point3d>();
      int count = 0;
      foreach(int he_index in dual.Faces.GetHalfedgesCirculator(i))
      {
        Point3d pt = dual.Vertices[dual.Halfedges[he_index].StartVertex].ToPoint3d();
        pts.Add(pt); pA += pt;
        pts_indices.Add(dual.Halfedges[he_index].StartVertex, new GH_Path(i));
        adjf_indices.Add(dual.Halfedges[dual.Halfedges.GetPairHalfedge(he_index)].AdjacentFace, new GH_Path(i));
        count++;
      }
      pA /= count;
      Plane.FitPlaneToPoints(pts, out pl);
      pl.Origin = pA;

      Vector3d vA = Vector3d.Zero;
      for(int k = 0;k < pts.Count;k++)
      {
        Point3d rpt = Point3d.Origin;
        pl.RemapToPlaneSpace(pts[k], out rpt);
        dom.T1 = dom.T1 > rpt.Z ? dom.T1 : rpt.Z;
        dom.T0 = dom.T0 < rpt.Z ? dom.T0 : rpt.Z;
        dom.T1 = dom.T1 > 0.05 ? dom.T1 : 0.05;
        dom.T0 = dom.T0 < -0.05 ? dom.T0 : -0.05;
        vA += Vector3d.CrossProduct(pts[k] - pA, pts[k < (pts.Count - 1) ? (k + 1) : 0] - pA);
      }
      vA.Unitize();
      if (vA * pl.ZAxis < 0)
      {
        pl.Flip();dom.T1 = 0 - dom.T0;dom.T0 = 0 - dom.T1;
      }
      pls.Add(pl);
      domains.Add(dom);
    }

    planktonMesh = dual;
    averagePlane = pls;
    faceVIndices = pts_indices;
    adjFaceIndices = adjf_indices;
    vertices = vts;
    thicknessDomains = domains;

    //construct solid
    DataTree<Plane> peri_planes = new DataTree<Plane>();
    DataTree<Plane> cen_planes = new DataTree<Plane>();
    for(int f_index = 0;f_index < dual.Faces.Count;f_index++)
    {
      int adjf_index,ptStart_index,ptEnd_index;
      int num = adjf_indices.Branch(pts_indices.Path(f_index)).Count;
      List<Plane> peri_pls = new  List<Plane>();
      for(int j = 0;j < num;j++)
      {
        ptStart_index = pts_indices[pts_indices.Path(f_index), j];
        ptEnd_index = pts_indices[pts_indices.Path(f_index), j == (num - 1) ? 0 : j + 1];
        Point3d s = vts[ptStart_index];
        Point3d e = vts[ptEnd_index];

        adjf_index = adjf_indices[adjf_indices.Path(f_index), j];
        Vector3d vecY;
        if(adjf_index != -1)
          vecY = pls[f_index].ZAxis + pls[adjf_index].ZAxis;
        else
          vecY = pls[f_index].ZAxis;
        peri_pls.Add(new Plane((s + e) / 2, s - e, vecY));
      }
      peri_planes.AddRange(peri_pls, new GH_Path(f_index));


      Plane[] cen_pls = new Plane[2]{pls[f_index],pls[f_index]};
      cen_pls[1].Translate(cen_pls[1].ZAxis * domains[f_index].T1);
      cen_pls[0].Translate(cen_pls[0].ZAxis * domains[f_index].T0);
      cen_pls[1].Flip();
      cen_planes.AddRange(cen_pls, new GH_Path(f_index));
    }
    periPlanes = peri_planes;
    cenPlanes = cen_planes;
# ---------- end c_script ----------
plane = Plane(simplify(c_script.periPlanes))
plane_2 = Plane(simplify(c_script.cenPlanes))
plane_offset = PlaneOffset(BasePlane=plane_2, Offset=Slider(0.25, range=0..1))
plane_offset_2 = PlaneOffset(BasePlane=plane, Offset=Slider(0.05, range=0..1))
list_item_2 = ListItem(List=plane_offset, Index=0, Wrap=True)  # -> Item, Item1
flip_plane = FlipPlane(Plane=list_item_2.Item1, FlipX=False, FlipY=False, FlipZ=True)  # -> Flipped, ResultBoolean
plane_region = PlaneRegion(Plane=list_item_2.Item, Bounds=plane_offset_2)
list_item_3 = ListItem(List=flatten(plane_region), Index=c_script.verticeIdAtAdjFaces, Wrap=True)
plane_region_2 = PlaneRegion(Plane=flip_plane.Flipped, Bounds=plane_offset_2)
list_item_4 = ListItem(List=flatten(plane_region_2), Index=c_script.verticeIdAtAdjFaces, Wrap=True)
flip_curve = FlipCurve(Curve=plane_region_2)  # -> Curve, Flag
control_polygon_2 = ControlPolygon(Curve=list_item_3)  # -> Polygon, Points
control_polygon_3 = ControlPolygon(Curve=list_item_4)  # -> Polygon, Points
merge = Merge(Data1=plane_region, Data2=flip_curve.Curve)
merge_2 = Merge(Data1=plane_region, Data2=plane_region_2)
list_item_5 = ListItem(List=simplify(control_polygon_2.Points), Index=simplify(graft(c_script.verticeAdjFacesId)), Wrap=invert(True))
list_item_6 = ListItem(List=simplify(control_polygon_3.Points), Index=simplify(graft(c_script.verticeAdjFacesId)), Wrap=invert(True))
number_slider = Slider(0.4, range=0..100)
parameter_loft_mesh = ParameterLoftMesh(
    Sections=merge_2,
    ParametersU=[0, 0.1, 0.2, 0.3, 0.4, 0.5, 0.6, 0.7, 0.8, 0.9, 1],
    ParametersV=[0, 1],
    Weighted=False,
    Lengths=invert(False),
    Angle=0,
    Closed=False,
    Triangulate=False)
from_polylines = FromPolylines(Curves=merge, Min_Triangulation=True)
line = Line(StartPoint=list_item_5, EndPoint=list_item_6)
unweld_mesh = UnweldMesh(Mesh=parameter_loft_mesh, Angle=0)
extend_curve = ExtendCurve(Curve=line, Type=0, Start=number_slider, End=number_slider)
merge_3 = Merge(Data1=from_polylines, Data2=unweld_mesh)
shift_paths = ShiftPaths(Data=extend_curve, Offset=-1)
mesh_join = MeshJoin(Meshes=flatten(merge_3))
point = Point(c_script.vertices)
end_points = EndPoints(Curve=shift_paths)  # -> Start, End
deconstruct = Deconstruct(Point=flatten(flip_plane.Flipped))  # -> XComponent, YComponent, ZComponent
average = Average(Input=end_points.End)
average_2 = Average(Input=end_points.Start)
reparameterize_numbers = ReparameterizeNumbers(Numbers=deconstruct.ZComponent, Invert=False)  # -> Reparameterized, Original
line_2 = Line(StartPoint=average_2, EndPoint=average)
plane_normal = PlaneNormal(Origin=graft(point), ZAxis=shift_paths)
plane_normal_2 = PlaneNormal(Origin=graft(point), ZAxis=line_2)
rotate_quaternion = RotateQuaternion(Plane1=plane_normal, Plane2=plane_normal_2, Factor=0.5)  # -> Rotated, Plane, Axis, Degree, Transform
gradient = Gradient(
    LowerLimit=0,
    UpperLimit=1,
    Parameter=reparameterize_numbers.Reparameterized,
    stops=[0: RGB(230, 222, 204), 1: RGB(183, 206, 235)])
radians = Radians(Degrees=rotate_quaternion.Degree)
create_material = CreateMaterial(Diffuse=gradient, Specular=RGB(255, 255, 255), Emission=RGB(0, 0, 0), Transparency=0, Shine=0)

# ----
# Planar blocks
custom_preview = CustomPreview(Geometry=mesh_join, Material=create_material)

square = Square(Value=radians)
mass_addition = MassAddition(Input=square)  # -> Result, PartialResults
reparameterize_numbers_2 = ReparameterizeNumbers(Numbers=flatten(mass_addition.Result), Invert=False)  # -> Reparameterized, Original

# ----
# torsion error
gradient_2 = Gradient(
    LowerLimit=0,
    UpperLimit=1,
    Parameter=reparameterize_numbers_2.Reparameterized,
    stops=[0: RGB(17, 255, 0), 0.192: RGB(255, 255, 0), 0.797: RGB(255, 0, 0)])
curve = Curve(flatten(line_2))
custom_preview_lineweights = CustomPreviewLineweights(Geometry=curve, Shader=gradient_2, Thickness=2, Absolute=False)
